# Grasshopper definition 05_sound.gh (Grasshopper 1.0.7)

pipeline = GeometryPipeline(
    GroupByLayer=False,
    GroupByType=False,
    IncludeHidden=True,
    IncludeLocked=True,
    LayerFilter="Lattice",
    NameFilter="*",
    SublayerFiltering=True,
    TypeFilter=1)
pipeline_2 = GeometryPipeline(
    GroupByLayer=False,
    GroupByType=False,
    IncludeHidden=True,
    IncludeLocked=True,
    LayerFilter="Road Loud",
    NameFilter="*",
    SublayerFiltering=True,
    TypeFilter=4)
pipeline_3 = GeometryPipeline(
    GroupByLayer=False,
    GroupByType=False,
    IncludeHidden=True,
    IncludeLocked=True,
    LayerFilter="Road Medium",
    NameFilter="*",
    SublayerFiltering=True,
    TypeFilter=4)
pipeline_4 = GeometryPipeline(
    GroupByLayer=False,
    GroupByType=False,
    IncludeHidden=True,
    IncludeLocked=True,
    LayerFilter="Road Silent",
    NameFilter="*",
    SublayerFiltering=True,
    TypeFilter=4)
pipeline_5 = GeometryPipeline(
    GroupByLayer=False,
    GroupByType=False,
    IncludeHidden=True,
    IncludeLocked=True,
    LayerFilter="Train",
    NameFilter="*",
    SublayerFiltering=True,
    TypeFilter=4)
pdecon = Deconstruct(Point=pipeline)  # -> XComponent, YComponent, ZComponent
cset = CreateSet(List=pdecon.ZComponent)  # -> Set, Map
item = ListItem(List=pipeline, Index=Slider(0, range=0..100), Wrap=True)
sort = SortList(Keys=cset.Set)  # -> Keys, ValuesA
pt = Point(item)
mindex = MemberIndex(Set=pdecon.ZComponent, Member=sort.Keys)  # -> Index, Count
item_2 = ListItem(List=pipeline, Index=mindex.Index, Wrap=True)
medium_db_lvl = Slider(60, range=40..80)
loud_db_lvl = Slider(70, range=40..80)
silent_db_lvl = Slider(50, range=40..80)
silent_db_lvl_2 = Slider(80, range=40..80)
circle = CircleCNR(Center=pt, Normal=Vector(0, 0, 1), Radius=Slider(750, range=0..50000))
trim = TrimWithRegion(Curve=pipeline_2, Region=circle)  # -> flatten(Inside), Outside
trim_2 = TrimWithRegion(Curve=pipeline_5, Region=circle)  # -> flatten(Inside), Outside
trim_3 = TrimWithRegion(Curve=pipeline_3, Region=circle)  # -> flatten(Inside), Outside
trim_4 = TrimWithRegion(Curve=pipeline_4, Region=circle)  # -> flatten(Inside), Outside
bang = ExplodeTree(Data=item_2)  # -> Branch0, Branch1, Branch2, Branch3, Branch4, Branch5, Branch6, Branch7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
number_slider = Slider(15, range=0..20)
len = Length(Curve=trim.Inside)
len_2 = Length(Curve=trim_3.Inside)
len_3 = Length(Curve=trim_4.Inside)
len_4 = Length(Curve=trim_2.Inside)
entwine = Entwine(Branch00=loud_db_lvl, Branch01=medium_db_lvl, Branch02=silent_db_lvl, Branch03=silent_db_lvl_2, FlattenInputs=True)
pdecon_2 = Deconstruct(Point=bang.Branch11)  # -> XComponent, YComponent, ZComponent
division = Division(A=len_2, B=number_slider)
division_2 = Division(A=len, B=number_slider)
division_3 = Division(A=len_3, B=number_slider)
division_4 = Division(A=len_4, B=number_slider)
expression = Expression(x=pdecon_2.XComponent, y=pdecon_2.YComponent, Expression="10000 * x + 100 * y ")
divide = DivideCurve(Curve=trim.Inside, Count=division_2, Kinks=False)  # -> flatten(Points), Tangents, Parameters
divide_2 = DivideCurve(Curve=trim_3.Inside, Count=division, Kinks=False)  # -> flatten(Points), Tangents, Parameters
divide_3 = DivideCurve(Curve=trim_4.Inside, Count=division_3, Kinks=False)  # -> flatten(Points), Tangents, Parameters
divide_4 = DivideCurve(Curve=trim_2.Inside, Count=division_4, Kinks=False)  # -> flatten(Points), Tangents, Parameters
sort_2 = SortList(Keys=expression, ValuesA=bang.Branch11)  # -> Keys, ValuesA
pt_2 = Point(graft(sort_2.ValuesA))
dist = Distance(PointA=pt_2, PointB=divide.Points)
dist_2 = Distance(PointA=pt_2, PointB=divide_2.Points)
dist_3 = Distance(PointA=pt_2, PointB=divide_4.Points)
dist_4 = Distance(PointA=pt_2, PointB=divide_3.Points)
data = Data(entwine)
expression_2 = Expression(x=dist_3, Expression="(log(x) / log(2))-1")
expression_3 = Expression(x=dist_4, Expression="(log(x) / log(2))-1")
expression_4 = Expression(x=dist, Expression="(log(x) / log(2))-1")
expression_5 = Expression(x=dist_2, Expression="(log(x) / log(2))-1")
number_slider_2 = Slider(6, range=0..10)
multiplication = Multiplication(A=expression_4, B=number_slider_2)
multiplication_2 = Multiplication(A=expression_5, B=number_slider_2)
multiplication_3 = Multiplication(A=expression_2, B=number_slider_2)
multiplication_4 = Multiplication(A=expression_3, B=number_slider_2)
bang_2 = ExplodeTree(Data=data)  # -> Branch0, Branch1, Branch2, Branch3
subtraction = Subtraction(A=bang_2.Branch0, B=multiplication)
subtraction_2 = Subtraction(A=bang_2.Branch1, B=multiplication_2)
subtraction_3 = Subtraction(A=bang_2.Branch2, B=multiplication_4)
subtraction_4 = Subtraction(A=bang_2.Branch3, B=multiplication_3)
num = Number(0)
eval = Evaluate(F="Max(x, 0.0)", x=subtraction)
eval_2 = Evaluate(F="Max(x, 0.0)", x=subtraction_3)
eval_3 = Evaluate(F="Max(x, 0.0)", x=subtraction_2)
eval_4 = Evaluate(F="Max(x, 0.0)", x=subtraction_4)
weave = Weave(Pattern=[0, 1, 2], Stream0=eval, Stream1=eval_3, Stream2=eval_2, Stream3=eval_4, NullGaps=False)
pt_3 = Point(sort_2.ValuesA)
pdecon_3 = Deconstruct(Point=pt_3)  # -> XComponent, YComponent, ZComponent
expression_6 = Expression(x=pdecon_3.XComponent, val=Slider(28.8, range=0..100), Expression="(x + val) / 3.6")
current_layer = Slider(11, range=0..100)
expression_7 = Expression(y=pdecon_3.YComponent, val=Slider(86.4, range=0..100), Expression="(y + val) / 3.6")
ma = MassAddition(Input=weave)  # -> flatten(Result), PartialResults
int = Integer(expression_6)
int_2 = Integer(current_layer)
int_3 = Integer(expression_7)
python = GhPythonScript(x=int, y=int_3, z=int_2, val=ma.Result, file_path="data/sound_z_11.txt", bool=Toggle(False))  # -> out, a; inputs x: list, y: list, val: list
# ---------- python: Python ----------
__author__ = "jirri"
__version__ = "2021.01.08"

import rhinoscriptsyntax as rs
import pickle
coords_val = []
if bool == True:
    for i in range(len(x)):
        coords_val.append([x[i], y[i], z, val[i]])
    with open(file_path, "wb") as fp:   #Pickling
        pickle.dump(coords_val, fp)
# ---------- end python ----------
panel = Panel(ma.Result)
