# Grasshopper definition 11_revit_pipeline.gh (Grasshopper 1.0.7)
# plug-ins: Rhino.Inside for Autodesk Revit

path = FilePath("C:\Users\jirri\Google Drive (jirrivdb@gmail.com)\Documenten\Spatial Computing Shared\Notebooks\Rhino Inside\gevels_3_6.txt")
python = GhPythonScript(status=Toggle(False), file_path=path)  # -> out, values, out_points, z_coords, full_points
# ---------- python: Python ----------
__author__ = "jirri"
__version__ = "2021.01.12"

import Rhino.Geometry as rg
import pickle as pickle
import Grasshopper as gh

minbound = [-28800, -86400, 1800.0]
shape = [44, 20, 16]
unit = 3600
out_points = []
full_points = []
value_list = []
z_list = []

def listToTree(nestedList):
    
    """ Convert a nested python iterable to a datatree """
    
    dt = gh.DataTree[object]()
    for i,l in enumerate(nestedList):
        dt.AddRange(l,gh.Kernel.Data.GH_Path(i))
        
    return dt

if status == True:
    with open(file_path, "rb") as fp:   # Unpickling
        import_lattice = pickle.load(fp)


    for i in import_lattice:
        if 1 in i[3]:
            out_point = rg.Point3d(i[0]*unit + minbound[0],i[1]*unit + minbound[1],i[2]*unit + minbound[2])
            out_points.append(out_point)
            value_list.append(i[3] + [0, 0])
        z_list.append(i[4])
        full_point = rg.Point3d(i[0]*unit + minbound[0],i[1]*unit + minbound[1],i[2]*unit + minbound[2])
        full_points.append(full_point)
        
    z_coords = listToTree(z_list)
    values = listToTree(value_list)
# ---------- end python ----------
number_slider = Slider(1800, range=0..10000)
number_slider_2 = Slider(1800, range=0..10000)
pt = Point([Point(-28800, -86400, 1800), Point(-28800, -86400, 5400), Point(-28800, -86400, 9000), Point(-28800, -86400, 12600), Point(-28800, -86400, 16200), Point(-28800, -86400, 19800)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])
pt_2 = Point([Point(-28800, -86400, 1800), Point(-28800, -86400, 5400), Point(-28800, -86400, 9000), Point(-28800, -86400, 12600), Point(-28800, -86400, 16200), Point(-28800, -86400, 19800)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])
Z = UnitZ(Factor=Slider(1800, range=0..10000))
box = CenterBox(Base=pt, X=number_slider, Y=number_slider, Z=number_slider)
move = Move(Geometry=pt_2, Motion=Z)  # -> Geometry, Transform
dom = ConstructDomain(DomainStart=expr("-x", number_slider_2), DomainEnd=number_slider_2)
debrep = DeconstructBrep(Brep=box)  # -> Faces, Edges, Vertices
xy = XYPlane(Origin=move.Geometry)
area = Area(Geometry=debrep.Faces)  # -> Area, Centroid
rectangle = Rectangle(Plane=xy, XSize=dom, YSize=dom, Radius=0)  # -> Rectangle, Length
data = Data(flatten(Tree({0}: [0], {1}: [0], {2}: [0], {3}: [0], {4}: [0], {5}: [0]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)))
panel = Panel("""{-1,0,0}
{0,1,0}
{1,0,0}
{0,-1,0}
{0,0,1}
{0,0,-1}""")
vec2pt = Vector2Pt(PointA=graft(pt), PointB=area.Centroid, Unitize=True)  # -> Vector, Length
sift = SiftPattern(List=rectangle.Rectangle, SiftPattern=data)  # -> Output0, Output1
cset = CreateSet(List=vec2pt.Vector)  # -> Set, Map
clean = CleanTree(RemoveNulls=True, RemoveInvalid=True, RemoveEmpty=False, Tree=sift.Output0)
fsim = FindSimilarMember(Data=panel, Set=cset.Set)  # -> Hit, Index
clean_2 = CleanTree(RemoveNulls=True, RemoveInvalid=True, RemoveEmpty=False, Tree=sift.Output1)
data_2 = Data(Tree({0}: [1, 0, 0, 1, 0, 0], {1}: [1, 0, 0, 1, 0, 0], {2}: [1, 0, 0, 1, 0, 0], {3}: [1, 0, 0, 1, 0, 0], {4}: [1, 0, 0, 1, 0, 0], {5}: [1, 0, 0, 1, 0, 0]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))
midpt = CurveMiddle(Curve=clean_2)
sort = SortList(Keys=fsim.Index, ValuesA=debrep.Faces)  # -> Keys, simplify(ValuesA)
midpt_2 = CurveMiddle(Curve=clean)
pdecon = Deconstruct(Point=midpt)  # -> XComponent, YComponent, ZComponent
pdecon_2 = Deconstruct(Point=midpt_2)  # -> XComponent, YComponent, ZComponent
cull = CullPattern(List=sort.ValuesA, CullPattern=data_2)
cset_2 = CreateSet(List=pdecon.ZComponent)  # -> Set, Map
cset_3 = CreateSet(List=pdecon_2.ZComponent)  # -> Set, Map
model = ModelCategoriesPicker({"Abutments": -2006130, "Air Systems": -2001008, "Air Terminals": -2008013, "Analysis Display Style": -2000304, "Analysis Results": -2000303, "Areas": -2003200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}, selected="Floors": -2000032)
srf = Surface(flatten(cull))
sort_2 = SortList(Keys=cset_2.Set)  # -> Keys, ValuesA
sort_3 = SortList(Keys=cset_3.Set)  # -> Keys, ValuesA
area_2 = Area(Geometry=srf)  # -> Area, Centroid
equals = Equality(FirstNumber=pdecon.ZComponent, SecondNumber=graft(sort_2.Keys))  # -> Equality, Inequality
equals_2 = Equality(FirstNumber=pdecon_2.ZComponent, SecondNumber=graft(sort_3.Keys))  # -> Equality, Inequality
pdecon_3 = Deconstruct(Point=area_2.Centroid)  # -> XComponent, YComponent, ZComponent
cull_2 = CullPattern(List=clean_2, CullPattern=equals.Equality)
cull_3 = CullPattern(List=clean, CullPattern=equals_2.Equality)
round = Round(Number=pdecon_3.ZComponent)  # -> Nearest, Floor, Ceiling
elementtype_picker = ElementTypePicker(
    model,
    {"Floor : 160mm Concrete With 50mm Metal Deck": "3fc50891-18f6-4a9e-9c11-567f9705cf9c-effed080-893e-40f3-a87f-5b6441efebb6-0001bb12", "Floor : Beam and Block 200mm": "3fc50891-18f6-4a9e-9c11-567f9705cf9c-458c0f21-01bb-11d5-9302-0000863f27ad-00000311", "Floor : Concrete-Commercial 362mm": "3fc50891-18f6-4a9e-9c11-567f9705cf9c-d8248334-23bb-11d5-9332-0000863f27ad-00001410", "Floor : Concrete-Domestic 425mm": "3fc50891-18f6-4a9e-9c11-567f9705cf9c-d8248334-23bb-11d5-9332-0000863f27ad-000013f9", "Floor : Generic 150mm": "3fc50891-18f6-4a9e-9c11-567f9705cf9c-e3e052f9-0156-11d5-9301-0000863f27ad-00000153", "Floor : Generic 150mm - Filled": "3fc50891-18f6-4a9e-9c11-567f9705cf9c-3671a0e3-71b5-47ea-b713-09ae9663984a-000049f0", "Floor : Generic 300mm": "3fc50891-18f6-4a9e-9c11-567f9705cf9c-458c0f14-01bb-11d5-9302-0000863f27ad-000002f7", "Floor : Insitu Concrete 225mm": "3fc50891-18f6-4a9e-9c11-567f9705cf9c-458c0f21-01bb-11d5-9302-0000863f27ad-00000312", "Floor : Standard Timber-Wood Finish": "3fc50891-18f6-4a9e-9c11-567f9705cf9c-458c0f21-01bb-11d5-9302-0000863f27ad-00000310"}, selected="Floor : 160mm Concrete With 50mm Metal Deck")
elementtype_picker_2 = ElementTypePicker(
    model,
    {"Floor : 160mm Concrete With 50mm Metal Deck": "3fc50891-18f6-4a9e-9c11-567f9705cf9c-effed080-893e-40f3-a87f-5b6441efebb6-0001bb12", "Floor : Beam and Block 200mm": "3fc50891-18f6-4a9e-9c11-567f9705cf9c-458c0f21-01bb-11d5-9302-0000863f27ad-00000311", "Floor : Concrete-Commercial 362mm": "3fc50891-18f6-4a9e-9c11-567f9705cf9c-d8248334-23bb-11d5-9332-0000863f27ad-00001410", "Floor : Concrete-Domestic 425mm": "3fc50891-18f6-4a9e-9c11-567f9705cf9c-d8248334-23bb-11d5-9332-0000863f27ad-000013f9", "Floor : Generic 150mm": "3fc50891-18f6-4a9e-9c11-567f9705cf9c-e3e052f9-0156-11d5-9301-0000863f27ad-00000153", "Floor : Generic 150mm - Filled": "3fc50891-18f6-4a9e-9c11-567f9705cf9c-3671a0e3-71b5-47ea-b713-09ae9663984a-000049f0", "Floor : Generic 300mm": "3fc50891-18f6-4a9e-9c11-567f9705cf9c-458c0f14-01bb-11d5-9302-0000863f27ad-000002f7", "Floor : Insitu Concrete 225mm": "3fc50891-18f6-4a9e-9c11-567f9705cf9c-458c0f21-01bb-11d5-9302-0000863f27ad-00000312", "Floor : Standard Timber-Wood Finish": "3fc50891-18f6-4a9e-9c11-567f9705cf9c-458c0f21-01bb-11d5-9302-0000863f27ad-00000310"}, selected="Floor : Standard Timber-Wood Finish")
runion = RegionUnion(Curves=cull_2)  # -> simplify(Result)
runion_2 = RegionUnion(Curves=cull_3)  # -> simplify(Result)
cset_4 = CreateSet(List=round.Nearest)  # -> Set, Map
series = Series(Start=Slider(1, range=0..100), Step=Slider(1, range=0..10000), Count=Slider(11, range=0..100))
series_2 = Series(Start=Slider(4, range=0..100), Step=Slider(1, range=0..10000), Count=Slider(12, range=0..100))
equals_3 = Equality(FirstNumber=round.Nearest, SecondNumber=graft(cset_4.Set))  # -> Equality, Inequality
levels = QueryLevels(Name=series, BuildingStory=True)  # -> simplify(Levels)
cull_4 = CullPattern(List=srf, CullPattern=equals_3.Equality)
levels_2 = QueryLevels(Name=series_2, BuildingStory=True)  # -> simplify(Levels)
edges = BrepEdges(Brep=cull_4)  # -> Naked, Interior, NonManifold
trim = TrimTree(Tree=edges.Naked, Depth=1)
floor = AddFloor(Boundary=runion_2, Type=elementtype_picker, Level=levels)
floor_2 = AddFloor(Boundary=runion, Type=elementtype_picker_2, Level=levels_2)
midpt_3 = CurveMiddle(Curve=trim)
series_3 = Series(Start=Slider(0, range=0..100), Step=Slider(3600, range=0..10000), Count=Slider(12, range=0..100))  # -> graft(Series)
model_2 = ModelCategoriesPicker({"Abutments": -2006130, "Air Systems": -2001008, "Air Terminals": -2008013, "Analysis Display Style": -2000304, "Analysis Results": -2000303, "Areas": -2003200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}, selected="Walls": -2000011)
pdecon_4 = Deconstruct(Point=midpt_3)  # -> XComponent, YComponent, ZComponent
equals_4 = Equality(FirstNumber=pdecon_4.ZComponent, SecondNumber=series_3)  # -> Equality, Inequality
cull_5 = CullPattern(List=trim, CullPattern=equals_4.Equality)  # -> simplify(List)
elementtype_picker_3 = ElementTypePicker(
    model_2,
    {"Basic Wall : CW 102-50-100p": "3fc50891-18f6-4a9e-9c11-567f9705cf9c-e3e052f9-0156-11d5-9301-0000863f27ad-00000198", "Basic Wall : CW 102-50-140p": "3fc50891-18f6-4a9e-9c11-567f9705cf9c-e3e052f9-0156-11d5-9301-0000863f27ad-0000019b", "Basic Wall : CW 102-50-215p": "3fc50891-18f6-4a9e-9c11-567f9705cf9c-e3e052f9-0156-11d5-9301-0000863f27ad-0000019c", "Basic Wall : CW 102-85-100p": "3fc50891-18f6-4a9e-9c11-567f9705cf9c-d8248334-23bb-11d5-9332-0000863f27ad-00001564", "Basic Wall : CW 102-85-140p": "3fc50891-18f6-4a9e-9c11-567f9705cf9c-e3e052f9-0156-11d5-9301-0000863f27ad-0000019a", "Basic Wall : CW 102-85-215p": "3fc50891-18f6-4a9e-9c11-567f9705cf9c-e3e052f9-0156-11d5-9301-0000863f27ad-0000019d"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}, selected="Basic Wall : CW 102-50-100p")
join = JoinCurves(Curves=cull_5, Preserve=True)  # -> simplify(Curves)
series_4 = Series(Start=Slider(0, range=0..100), Step=Slider(1, range=0..10000), Count=Slider(12, range=0..100))
simplify = SimplifyCurve(Curve=join)  # -> Curve, Simplified
levels_3 = QueryLevels(Name=series_4, BuildingStory=True)  # -> simplify(Levels)
explode = Explode(Curve=simplify.Curve, Recursive=True)  # -> Segments, Vertices
crv = Curve(flatten(explode.Segments))
wallcrv = AddWallCurve(
    Curve=explode.Segments,
    Type=elementtype_picker_3,
    Level=levels_3,
    Height=Slider(3600, range=0..10000),
    Flipped=True,
    AllowJoins=True)
end = EndPoints(Curve=crv)  # -> Start, End
flatten = FlattenTree(Tree=wallcrv, Path="{0}")
panel_2 = Panel(explode.Segments)
xy_2 = XYPlane(Origin=Point(0, 0, 0))
vec2pt_2 = Vector2Pt(PointA=end.Start, PointB=end.End, Unitize=False)  # -> unitize(Vector), Length
model_3 = ModelCategoriesPicker({"Abutments": -2006130, "Air Systems": -2001008, "Air Terminals": -2008013, "Analysis Display Style": -2000304, "Analysis Results": -2000303, "Areas": -2003200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}, selected="Windows": -2000014)
number_slider_3 = Slider(383, range=0..383)
move_2 = Move(Geometry=crv, Motion=expr("x*1800", vec2pt_2.Vector))  # -> Geometry, Transform
vrot = Rotate(Vector=vec2pt_2.Vector, Axis=xy_2, Angle=expr("-x", degrees(Slider(90, range=0..100))))
len = Length(Curve=move_2.Geometry)  # -> expr("x/3600", Length)
divide = DivideCurve(Curve=move_2.Geometry, Count=len, Kinks=False)  # -> Points, Tangents, Parameters
elementtype_picker_4 = ElementTypePicker(
    model_3,
    {"M_Fixed : 0406 x 0610mm": "3fc50891-18f6-4a9e-9c11-567f9705cf9c-04d1f996-00c3-4cd4-a075-3c8bb4e6970c-0000812b", "M_Fixed : 0406 x 1220mm": "3fc50891-18f6-4a9e-9c11-567f9705cf9c-04d1f996-00c3-4cd4-a075-3c8bb4e6970c-0000812d", "M_Fixed : 0406 x 1830mm": "3fc50891-18f6-4a9e-9c11-567f9705cf9c-04d1f996-00c3-4cd4-a075-3c8bb4e6970c-00008137", "M_Fixed : 0610 x 0610mm": "3fc50891-18f6-4a9e-9c11-567f9705cf9c-04d1f996-00c3-4cd4-a075-3c8bb4e6970c-0000812f", "M_Fixed : 0610 x 1220mm": "3fc50891-18f6-4a9e-9c11-567f9705cf9c-04d1f996-00c3-4cd4-a075-3c8bb4e6970c-00008131", "M_Fixed : 0610 x 1830mm": "3fc50891-18f6-4a9e-9c11-567f9705cf9c-04d1f996-00c3-4cd4-a075-3c8bb4e6970c-00008139", "M_Fixed : 0915 x 0610mm": "3fc50891-18f6-4a9e-9c11-567f9705cf9c-04d1f996-00c3-4cd4-a075-3c8bb4e6970c-00008133", "M_Fixed : 0915 x 1220mm": "3fc50891-18f6-4a9e-9c11-567f9705cf9c-04d1f996-00c3-4cd4-a075-3c8bb4e6970c-00008135", "M_Fixed : 0915 x 1830mm": "3fc50891-18f6-4a9e-9c11-567f9705cf9c-04d1f996-00c3-4cd4-a075-3c8bb4e6970c-0000813b", "M_Fixed : 2000 x 2000mm": "3fc50891-18f6-4a9e-9c11-567f9705cf9c-16d1d05e-c9bb-4b72-a129-3f979cffc302-0005540c", "M_Fixed : 2800 x 2800mm": "3fc50891-18f6-4a9e-9c11-567f9705cf9c-16d1d05e-c9bb-4b72-a129-3f979cffc302-00055404", "M_Fixed : 3200 x 3200mm": "3fc50891-18f6-4a9e-9c11-567f9705cf9c-16d1d05e-c9bb-4b72-a129-3f979cffc302-00055352", "M_Window-Casement-Double : 1050 x 1350mm": "3fc50891-18f6-4a9e-9c11-567f9705cf9c-2505ffa1-4b7a-413e-9a94-219455c52699-00052b26", "M_Window-Casement-Double : 1200 x 1500mm": "3fc50891-18f6-4a9e-9c11-567f9705cf9c-2505ffa1-4b7a-413e-9a94-219455c52699-00052b28", "M_Window-Casement-Double : 1400 x 1800mm": "3fc50891-18f6-4a9e-9c11-567f9705cf9c-2505ffa1-4b7a-413e-9a94-219455c52699-00052b2a", "M_Window-Casement-Double : 850 x 900mm": "3fc50891-18f6-4a9e-9c11-567f9705cf9c-2505ffa1-4b7a-413e-9a94-219455c52699-00052b24", "M_Window-Double-Hung : 600 x 1100mm": "3fc50891-18f6-4a9e-9c11-567f9705cf9c-2505ffa1-4b7a-413e-9a94-219455c52699-00051808", "M_Window-Double-Hung : 650 x 1100mm": "3fc50891-18f6-4a9e-9c11-567f9705cf9c-2505ffa1-4b7a-413e-9a94-219455c52699-0005180a", "M_Window-Double-Hung : 700 x 1200mm": "3fc50891-18f6-4a9e-9c11-567f9705cf9c-2505ffa1-4b7a-413e-9a94-219455c52699-0005180c", "M_Window-Double-Hung : 750 x 1200mm": "3fc50891-18f6-4a9e-9c11-567f9705cf9c-2505ffa1-4b7a-413e-9a94-219455c52699-0005180e", "window variable : window variable": "3fc50891-18f6-4a9e-9c11-567f9705cf9c-16d1d05e-c9bb-4b72-a129-3f979cffc302-00054ce0"}, selected="M_Fixed : 2000 x 2000mm")
elementtype_picker_5 = ElementTypePicker(
    model_3,
    {"M_Fixed : 0406 x 0610mm": "3fc50891-18f6-4a9e-9c11-567f9705cf9c-04d1f996-00c3-4cd4-a075-3c8bb4e6970c-0000812b", "M_Fixed : 0406 x 1220mm": "3fc50891-18f6-4a9e-9c11-567f9705cf9c-04d1f996-00c3-4cd4-a075-3c8bb4e6970c-0000812d", "M_Fixed : 0406 x 1830mm": "3fc50891-18f6-4a9e-9c11-567f9705cf9c-04d1f996-00c3-4cd4-a075-3c8bb4e6970c-00008137", "M_Fixed : 0610 x 0610mm": "3fc50891-18f6-4a9e-9c11-567f9705cf9c-04d1f996-00c3-4cd4-a075-3c8bb4e6970c-0000812f", "M_Fixed : 0610 x 1220mm": "3fc50891-18f6-4a9e-9c11-567f9705cf9c-04d1f996-00c3-4cd4-a075-3c8bb4e6970c-00008131", "M_Fixed : 0610 x 1830mm": "3fc50891-18f6-4a9e-9c11-567f9705cf9c-04d1f996-00c3-4cd4-a075-3c8bb4e6970c-00008139", "M_Fixed : 0915 x 0610mm": "3fc50891-18f6-4a9e-9c11-567f9705cf9c-04d1f996-00c3-4cd4-a075-3c8bb4e6970c-00008133", "M_Fixed : 0915 x 1220mm": "3fc50891-18f6-4a9e-9c11-567f9705cf9c-04d1f996-00c3-4cd4-a075-3c8bb4e6970c-00008135", "M_Fixed : 0915 x 1830mm": "3fc50891-18f6-4a9e-9c11-567f9705cf9c-04d1f996-00c3-4cd4-a075-3c8bb4e6970c-0000813b", "M_Fixed : 2000 x 2000mm": "3fc50891-18f6-4a9e-9c11-567f9705cf9c-16d1d05e-c9bb-4b72-a129-3f979cffc302-0005540c", "M_Fixed : 2800 x 2800mm": "3fc50891-18f6-4a9e-9c11-567f9705cf9c-16d1d05e-c9bb-4b72-a129-3f979cffc302-00055404", "M_Fixed : 3200 x 3200mm": "3fc50891-18f6-4a9e-9c11-567f9705cf9c-16d1d05e-c9bb-4b72-a129-3f979cffc302-00055352", "M_Window-Casement-Double : 1050 x 1350mm": "3fc50891-18f6-4a9e-9c11-567f9705cf9c-2505ffa1-4b7a-413e-9a94-219455c52699-00052b26", "M_Window-Casement-Double : 1200 x 1500mm": "3fc50891-18f6-4a9e-9c11-567f9705cf9c-2505ffa1-4b7a-413e-9a94-219455c52699-00052b28", "M_Window-Casement-Double : 1400 x 1800mm": "3fc50891-18f6-4a9e-9c11-567f9705cf9c-2505ffa1-4b7a-413e-9a94-219455c52699-00052b2a", "M_Window-Casement-Double : 850 x 900mm": "3fc50891-18f6-4a9e-9c11-567f9705cf9c-2505ffa1-4b7a-413e-9a94-219455c52699-00052b24", "M_Window-Double-Hung : 600 x 1100mm": "3fc50891-18f6-4a9e-9c11-567f9705cf9c-2505ffa1-4b7a-413e-9a94-219455c52699-00051808", "M_Window-Double-Hung : 650 x 1100mm": "3fc50891-18f6-4a9e-9c11-567f9705cf9c-2505ffa1-4b7a-413e-9a94-219455c52699-0005180a", "M_Window-Double-Hung : 700 x 1200mm": "3fc50891-18f6-4a9e-9c11-567f9705cf9c-2505ffa1-4b7a-413e-9a94-219455c52699-0005180c", "M_Window-Double-Hung : 750 x 1200mm": "3fc50891-18f6-4a9e-9c11-567f9705cf9c-2505ffa1-4b7a-413e-9a94-219455c52699-0005180e", "window variable : window variable": "3fc50891-18f6-4a9e-9c11-567f9705cf9c-16d1d05e-c9bb-4b72-a129-3f979cffc302-00054ce0"}, selected="M_Fixed : 3200 x 3200mm")
elementtype_picker_6 = ElementTypePicker(
    model_3,
    {"M_Fixed : 0406 x 0610mm": "3fc50891-18f6-4a9e-9c11-567f9705cf9c-04d1f996-00c3-4cd4-a075-3c8bb4e6970c-0000812b", "M_Fixed : 0406 x 1220mm": "3fc50891-18f6-4a9e-9c11-567f9705cf9c-04d1f996-00c3-4cd4-a075-3c8bb4e6970c-0000812d", "M_Fixed : 0406 x 1830mm": "3fc50891-18f6-4a9e-9c11-567f9705cf9c-04d1f996-00c3-4cd4-a075-3c8bb4e6970c-00008137", "M_Fixed : 0610 x 0610mm": "3fc50891-18f6-4a9e-9c11-567f9705cf9c-04d1f996-00c3-4cd4-a075-3c8bb4e6970c-0000812f", "M_Fixed : 0610 x 1220mm": "3fc50891-18f6-4a9e-9c11-567f9705cf9c-04d1f996-00c3-4cd4-a075-3c8bb4e6970c-00008131", "M_Fixed : 0610 x 1830mm": "3fc50891-18f6-4a9e-9c11-567f9705cf9c-04d1f996-00c3-4cd4-a075-3c8bb4e6970c-00008139", "M_Fixed : 0915 x 0610mm": "3fc50891-18f6-4a9e-9c11-567f9705cf9c-04d1f996-00c3-4cd4-a075-3c8bb4e6970c-00008133", "M_Fixed : 0915 x 1220mm": "3fc50891-18f6-4a9e-9c11-567f9705cf9c-04d1f996-00c3-4cd4-a075-3c8bb4e6970c-00008135", "M_Fixed : 0915 x 1830mm": "3fc50891-18f6-4a9e-9c11-567f9705cf9c-04d1f996-00c3-4cd4-a075-3c8bb4e6970c-0000813b", "M_Fixed : 2000 x 2000mm": "3fc50891-18f6-4a9e-9c11-567f9705cf9c-16d1d05e-c9bb-4b72-a129-3f979cffc302-0005540c", "M_Fixed : 2800 x 2800mm": "3fc50891-18f6-4a9e-9c11-567f9705cf9c-16d1d05e-c9bb-4b72-a129-3f979cffc302-00055404", "M_Fixed : 3200 x 3200mm": "3fc50891-18f6-4a9e-9c11-567f9705cf9c-16d1d05e-c9bb-4b72-a129-3f979cffc302-00055352", "M_Window-Casement-Double : 1050 x 1350mm": "3fc50891-18f6-4a9e-9c11-567f9705cf9c-2505ffa1-4b7a-413e-9a94-219455c52699-00052b26", "M_Window-Casement-Double : 1200 x 1500mm": "3fc50891-18f6-4a9e-9c11-567f9705cf9c-2505ffa1-4b7a-413e-9a94-219455c52699-00052b28", "M_Window-Casement-Double : 1400 x 1800mm": "3fc50891-18f6-4a9e-9c11-567f9705cf9c-2505ffa1-4b7a-413e-9a94-219455c52699-00052b2a", "M_Window-Casement-Double : 850 x 900mm": "3fc50891-18f6-4a9e-9c11-567f9705cf9c-2505ffa1-4b7a-413e-9a94-219455c52699-00052b24", "M_Window-Double-Hung : 600 x 1100mm": "3fc50891-18f6-4a9e-9c11-567f9705cf9c-2505ffa1-4b7a-413e-9a94-219455c52699-00051808", "M_Window-Double-Hung : 650 x 1100mm": "3fc50891-18f6-4a9e-9c11-567f9705cf9c-2505ffa1-4b7a-413e-9a94-219455c52699-0005180a", "M_Window-Double-Hung : 700 x 1200mm": "3fc50891-18f6-4a9e-9c11-567f9705cf9c-2505ffa1-4b7a-413e-9a94-219455c52699-0005180c", "M_Window-Double-Hung : 750 x 1200mm": "3fc50891-18f6-4a9e-9c11-567f9705cf9c-2505ffa1-4b7a-413e-9a94-219455c52699-0005180e", "window variable : window variable": "3fc50891-18f6-4a9e-9c11-567f9705cf9c-16d1d05e-c9bb-4b72-a129-3f979cffc302-00054ce0"}, selected="M_Fixed : 2800 x 2800mm")
elementtype_picker_7 = ElementTypePicker(
    model_3,
    {"M_Fixed : 0406 x 0610mm": "3fc50891-18f6-4a9e-9c11-567f9705cf9c-04d1f996-00c3-4cd4-a075-3c8bb4e6970c-0000812b", "M_Fixed : 0406 x 1220mm": "3fc50891-18f6-4a9e-9c11-567f9705cf9c-04d1f996-00c3-4cd4-a075-3c8bb4e6970c-0000812d", "M_Fixed : 0406 x 1830mm": "3fc50891-18f6-4a9e-9c11-567f9705cf9c-04d1f996-00c3-4cd4-a075-3c8bb4e6970c-00008137", "M_Fixed : 0610 x 0610mm": "3fc50891-18f6-4a9e-9c11-567f9705cf9c-04d1f996-00c3-4cd4-a075-3c8bb4e6970c-0000812f", "M_Fixed : 0610 x 1220mm": "3fc50891-18f6-4a9e-9c11-567f9705cf9c-04d1f996-00c3-4cd4-a075-3c8bb4e6970c-00008131", "M_Fixed : 0610 x 1830mm": "3fc50891-18f6-4a9e-9c11-567f9705cf9c-04d1f996-00c3-4cd4-a075-3c8bb4e6970c-00008139", "M_Fixed : 0915 x 0610mm": "3fc50891-18f6-4a9e-9c11-567f9705cf9c-04d1f996-00c3-4cd4-a075-3c8bb4e6970c-00008133", "M_Fixed : 0915 x 1220mm": "3fc50891-18f6-4a9e-9c11-567f9705cf9c-04d1f996-00c3-4cd4-a075-3c8bb4e6970c-00008135", "M_Fixed : 0915 x 1830mm": "3fc50891-18f6-4a9e-9c11-567f9705cf9c-04d1f996-00c3-4cd4-a075-3c8bb4e6970c-0000813b", "M_Fixed : 2000 x 2000mm": "3fc50891-18f6-4a9e-9c11-567f9705cf9c-16d1d05e-c9bb-4b72-a129-3f979cffc302-0005540c", "M_Fixed : 2800 x 2800mm": "3fc50891-18f6-4a9e-9c11-567f9705cf9c-16d1d05e-c9bb-4b72-a129-3f979cffc302-00055404", "M_Fixed : 3200 x 3200mm": "3fc50891-18f6-4a9e-9c11-567f9705cf9c-16d1d05e-c9bb-4b72-a129-3f979cffc302-00055352", "M_Window-Casement-Double : 1050 x 1350mm": "3fc50891-18f6-4a9e-9c11-567f9705cf9c-2505ffa1-4b7a-413e-9a94-219455c52699-00052b26", "M_Window-Casement-Double : 1200 x 1500mm": "3fc50891-18f6-4a9e-9c11-567f9705cf9c-2505ffa1-4b7a-413e-9a94-219455c52699-00052b28", "M_Window-Casement-Double : 1400 x 1800mm": "3fc50891-18f6-4a9e-9c11-567f9705cf9c-2505ffa1-4b7a-413e-9a94-219455c52699-00052b2a", "M_Window-Casement-Double : 850 x 900mm": "3fc50891-18f6-4a9e-9c11-567f9705cf9c-2505ffa1-4b7a-413e-9a94-219455c52699-00052b24", "M_Window-Double-Hung : 600 x 1100mm": "3fc50891-18f6-4a9e-9c11-567f9705cf9c-2505ffa1-4b7a-413e-9a94-219455c52699-00051808", "M_Window-Double-Hung : 650 x 1100mm": "3fc50891-18f6-4a9e-9c11-567f9705cf9c-2505ffa1-4b7a-413e-9a94-219455c52699-0005180a", "M_Window-Double-Hung : 700 x 1200mm": "3fc50891-18f6-4a9e-9c11-567f9705cf9c-2505ffa1-4b7a-413e-9a94-219455c52699-0005180c", "M_Window-Double-Hung : 750 x 1200mm": "3fc50891-18f6-4a9e-9c11-567f9705cf9c-2505ffa1-4b7a-413e-9a94-219455c52699-0005180e", "window variable : window variable": "3fc50891-18f6-4a9e-9c11-567f9705cf9c-16d1d05e-c9bb-4b72-a129-3f979cffc302-00054ce0"}, selected="M_Fixed : 2800 x 2800mm")
panel_3 = Panel("""{-1,0,0}
{0,1,0}
{1,0,0}
{0,-1,0}""")
lng = ListLength(List=divide.Points)  # -> expr("x-1", Length)
item = ListItem(List=vrot, Index=number_slider_3, Wrap=True)
cull_i = CullIndex(List=divide.Points, Indices=lng, Wrap=True)  # -> simplify(List)
fsim_2 = FindSimilarMember(Data=item, Set=panel_3)  # -> Hit, Index
panel_4 = Panel("""2000
2800
3200
2800""")
item_2 = ListItem(List=panel_4, Index=fsim_2.Index, Wrap=True)
path_2 = ConstructPath(Indices=number_slider_3)
entwine = Entwine(
    Branch00=elementtype_picker_4,
    Branch01=elementtype_picker_7,
    Branch02=elementtype_picker_5,
    Branch03=elementtype_picker_6,
    FlattenInputs=True)  # -> flatten(Result)
expression = Expression(x=item_2, Expression="(3600-x)/2")
branch = TreeBranch(Tree=cull_i, Path=path_2, MaintainPaths=True)
Z_2 = UnitZ(Factor=expression)
move_3 = Move(Geometry=branch, Motion=Z_2)  # -> Geometry, Transform
item_3 = ListItem(List=flatten, Index=number_slider_3, Wrap=True)
item_4 = ListItem(List=entwine, Index=fsim_2.Index, Wrap=True)
comploca = AddComponentLocation(Location=move_3.Geometry, Type=item_4, Host=item_3)
